# Grasshopper definition AddSurfaceArea.gh (Grasshopper 1.0.7)
# plug-ins: RhinoCityJSON

# ---- group: Adjust to file!
toggle = BooleanToggle(False)
path = FilePath()
pt = Point(Point(0, 0, 0))
panel = Panel("50")
panel_2 = Panel("2")

# ----
toggle_2 = BooleanToggle(True)
rsettings = ReaderSettings(Translate=toggle, ModelOrigin=pt, TrueNorth=panel, LoD=panel_2)
reader = RCJReader(Path=path, Activate=toggle_2, Settings=rsettings)  # -> Geometry, SurfaceInfoKeys, SurfaceInfoVales, ObjectInfoKeys, ObjectInfoValues
reader_2 = RCJReader(Path=path, Activate=toggle_2, Settings=rsettings)  # -> Geometry, SurfaceInfoKeys, SurfaceInfoVales, ObjectInfoKeys, ObjectInfoValues

# ---- group: Add the Area Key
merge = Merge(Data1=reader_2.SurfaceInfoKeys, Data2=graft("Surface Area"))

# ---- group: Add the Area Value
area = Area(Geometry=reader_2.Geometry)  # -> simplify(graft(Area)), Centroid

# ----
merge_2 = Merge(Data1=reader_2.SurfaceInfoVales, Data2=area.Area)
imanage = InformationManager(
    Geometry=reader_2.Geometry,
    SurfaceInfoKeys=merge,
    SurfaceInfoVales=merge_2,
    ObjectInfoKeys=reader_2.ObjectInfoKeys,
    ObjectInfoValues=reader_2.ObjectInfoValues)  # -> Geometry, MergedSurfaceInfoKeys, MergedSurfaceInfoVales
bakery = RCJBakery(
    Geometry=imanage.Geometry,
    SurfaceInfoKeys=imanage.MergedSurfaceInfoKeys,
    SurfaceInfo=imanage.MergedSurfaceInfoVales,
    Activate=Button())
