# Grasshopper definition ReadAndBakeFile.gh (Grasshopper 1.0.7)
# plug-ins: RhinoCityJSON

# ---- group: Adjust to file!
toggle = BooleanToggle(False)
path = FilePath()
pt = Point(Point(0, 0, 0))
panel = Panel("50")
panel_2 = Panel("1.3")

# ----
toggle_2 = BooleanToggle(True)
rsettings = ReaderSettings(Translate=toggle, ModelOrigin=pt, TrueNorth=panel, LoD=panel_2)
treader = RCJTemplateReader(Path=path, Activate=toggle_2)  # -> TemplateGeometry, SurfaceInfoKeys, SurfaceInfoValues, ObjectInfoKeys, ObjectInfoValues
reader = RCJReader(Path=path, Activate=toggle_2, Settings=rsettings)  # -> Geometry, SurfaceInfoKeys, SurfaceInfoValues, ObjectInfoKeys, ObjectInfoValues
dreader = DocumentReader(Path=path, Activate=toggle_2)  # -> MetadataKeys, MetadataValues, LoD, Materials
imanage = InformationManager(
    Geometry=reader.Geometry,
    SurfaceInfoKeys=reader.SurfaceInfoKeys,
    SurfaceInfoValues=reader.SurfaceInfoValues,
    ObjectInfoKeys=reader.ObjectInfoKeys,
    ObjectInfoValues=reader.ObjectInfoValues)  # -> Geometry, MergedSurfaceInfoKeys, MergedSurfaceInfoValues
button = Button()
baking = Bakery(
    Geometry=imanage.Geometry,
    SurfaceInfoKeys=imanage.MergedSurfaceInfoKeys,
    SurfaceInfo=imanage.MergedSurfaceInfoValues,
    Materials=dreader.Materials,
    Activate=button)
tbakery = TemplateBakery(
    TemplateGeometry=treader.TemplateGeometry,
    SurfaceInfoKeys=treader.SurfaceInfoKeys,
    SurfaceInfo=treader.SurfaceInfoValues,
    ObjectInfoKeys=treader.ObjectInfoKeys,
    ObjectInfo=treader.ObjectInfoValues,
    Materials=dreader.Materials,
    Activate=button)
